# Dynamo custom node Xframe3DExportXML.dyf (Dynamo 2.0.2.6826)
# category: Dyn2Calc.Xframe3d
# Export XML-file from Revit

string = StringInput("<?xml version=\"1.0\" encoding=\"utf-8\"?>")  # graph input
categories = Categories(index=368)  # graph input
all_elements_of_category = ElementsOfCategory(Category=categories)
code_block = CodeBlock(t1=all_elements_of_category)
# ---------- code_block.designscript (11 lines) ----------
ProjectInfo = DSCore.List.FirstItem(t1);
ProjectInfo.GetParameterValueByName("Project Name");
ProjectInfo.GetParameterValueByName("Project Number");
"<Frame>";
"<ProjectName>";
"</ProjectName>";
"<ProjectNumber>";
"</ProjectNumber>";
"<ExportDateTime>";
"</ExportDateTime>";
"<XMLExportVersion> v4.0.30319 </XMLExportVersion>";
# ----------------------------------------
code_block_2 = CodeBlock { t1 = DSCore.DateTime.Now; }
string_from_object = FromObject(obj=code_block_2)
concat = String.Concat(string0=string, string1=code_block.out3, string2=code_block.out4, string3=code_block.out1, string4=code_block.out5, string5=code_block.out6, string6=code_block.out2, string7=code_block.out7, string8=code_block.out8, string9=string_from_object, string10=code_block.out9, string11=code_block.out10)
Analytical_Nodes = Input(Analytical Nodes: var[]..[])
code_block_3 = CodeBlock { 2; 0; }
takeEveryNthItem = List.TakeEveryNthItem(list=Analytical_Nodes, n=code_block_3.out0, offset=code_block_3.out1)
count = List.Count(list=takeEveryNthItem)

# group: POINT AND NUMBER OF ANALYTICAL NODES
code_block_4 = CodeBlock(x=count) { 1..x..1; }
point = ReferencePoint.Point(referencePoint=takeEveryNthItem)

string_from_object_2 = FromObject(obj=code_block_4)
code_block_5 = CodeBlock { "<Number>"; "</Number>"; }
concat_2 = String.Concat(string0=code_block_5.out0, string2=code_block_5.out1)  # unwired: string1
map = List.Map(list=string_from_object_2, f_x=concat_2)
code_block_6 = CodeBlock(NODES=point) { t1 = NODES.X; X = Math.Round(t1); Y = Math.Round(NODES.Y); Z = Math.Round(NODES.Z); }
string_from_object_3 = FromObject(obj=code_block_6.X)
code_block_7 = CodeBlock(t3=string_from_object_3) { t2 = String.Split(t3, [","]); t4 = DSCore.List.FirstItem(t2@-2<1>); }
code_block_8 = CodeBlock { "<X>"; "</X>"; }
concat_3 = String.Concat(string0=code_block_8.out0, string2=code_block_8.out1)  # unwired: string1
map_2 = List.Map(list=code_block_7.t4, f_x=concat_3)
string_from_object_4 = FromObject(obj=code_block_6.Y)
code_block_9 = CodeBlock(t3=string_from_object_4) { t2 = String.Split(t3, [","]); t4 = DSCore.List.FirstItem(t2@-2<1>); }
code_block_10 = CodeBlock { "<Y>"; "</Y>"; }
concat_4 = String.Concat(string0=code_block_10.out0, string2=code_block_10.out1)  # unwired: string1
map_3 = List.Map(list=code_block_9.t4, f_x=concat_4)
string_from_object_5 = FromObject(obj=code_block_6.Z)
code_block_11 = CodeBlock(t3=string_from_object_5) { t2 = String.Split(t3, [","]); t4 = DSCore.List.FirstItem(t2@-2<1>); }
code_block_12 = CodeBlock { "<Z>"; "</Z>"; }
concat_5 = String.Concat(string0=code_block_12.out0, string2=code_block_12.out1)  # unwired: string1
map_4 = List.Map(list=code_block_11.t4, f_x=concat_5)
create = List.Create(item0=map, item1=map_2, item2=map_3, item3=map_4)
transpose = List.Transpose(lists=create)
flatten = List.Flatten(list=transpose)
string_from_array = FromArray(arr=flatten)
code_block_13 = CodeBlock { ","; ""; "{"; "}"; }

# group: XML <NODES>
code_block_14 = CodeBlock { "<Nodes>"; "</Nodes>"; }
replace = String.Replace(str=string_from_array, searchFor=code_block_13.out0, replaceWith=code_block_13.out1)
replace_2 = String.Replace(str=replace, searchFor=code_block_13.out2, replaceWith=code_block_13.out1)
replace_3 = String.Replace(str=replace_2, searchFor=code_block_13.out3, replaceWith=code_block_13.out1)
concat_6 = String.Concat(string0=code_block_14.out0, string1=replace_3, string2=code_block_14.out1)

Grids = Input(Grids: var[]..[])
curve = CurveElement.Curve(curveElement=Grids)
code_block_15 = CodeBlock { "Name"; }
getParameterValueByName = Element.GetParameterValueByName(element=Grids, parameterName=code_block_15)

# group: X-GRID ORDERY BY COORDINATE CALCULATE DY
direction = Line.Direction(line=curve)
YAxis = Vector.YAxis()
isParallel = Vector.IsParallel(vector=direction, other=YAxis)
filterByBoolMask = List.FilterByBoolMask(list=curve, mask=isParallel)
startPoint = Curve.StartPoint(curve=filterByBoolMask.in)
X = Point.X(point=startPoint)
sort = List.Sort(list=X)
code_block_16 = CodeBlock { -1; 0; }
dropItems = List.DropItems(list=sort, amount=code_block_16.out0)
addItemToFront = List.AddItemToFront(item=code_block_16.out1, list=dropItems)
sub = sort - addItemToFront
string_from_object_6 = FromObject(obj=sub)
code_block_17 = CodeBlock { ","; }
split = String.Split(str=string_from_object_6, separater0=code_block_17)
firstItem = List.FirstItem(list=split@L2)
string_from_array_2 = FromArray(arr=firstItem)
code_block_18 = CodeBlock(t7=string_from_array_2) { t6 = String.Replace(t7, ",", " "); t8 = String.Replace(t6, "{", ""); t9 = String.Replace(t8, "}", ""); }
filterByBoolMask_2 = List.FilterByBoolMask(list=getParameterValueByName, mask=isParallel)
byKeysValues = Custom[Springs.Dictionary.ByKeysValues](keys=X, values=filterByBoolMask_2.in, searchKeys=sort)  # Dictionaries are an incredibly powerful tool for making associative sets between two equal length lists. The first list must be of unique strings (or numbers) and will be the key and the second list will be the matching values (it can be made up of geometry, elements, even other lists) The search keys list will provide the corresponding value to the input key.
string_from_array_3 = FromArray(arr=byKeysValues)
code_block_19 = CodeBlock(t7=string_from_array_3) { t6 = String.Replace(t7, ",", " "); t8 = String.Replace(t6, "{", ""); t9 = String.Replace(t8, "}", ""); }

# group: XML X-GRID
code_block_20 = CodeBlock { "<X>"; "</X>"; "<X_Lable>"; "</X_Lable>"; }
concat_7 = String.Concat(string0=code_block_20.out0, string1=code_block_18.t9, string2=code_block_20.out1, string3=code_block_20.out2, string4=code_block_19.t9, string5=code_block_20.out3)

# group: Y-GRID ORDER BY COORDINATE CALCULATE DX
direction_2 = Line.Direction(line=curve)
XAxis = Vector.XAxis()
isParallel_2 = Vector.IsParallel(vector=direction_2, other=XAxis)
filterByBoolMask_3 = List.FilterByBoolMask(list=curve, mask=isParallel_2)
startPoint_2 = Curve.StartPoint(curve=filterByBoolMask_3.in)
Y = Point.Y(point=startPoint_2)
sort_2 = List.Sort(list=Y)
code_block_21 = CodeBlock { -1; 0; }
dropItems_2 = List.DropItems(list=sort_2, amount=code_block_21.out0)
addItemToFront_2 = List.AddItemToFront(item=code_block_21.out1, list=dropItems_2)
sub_2 = sort_2 - addItemToFront_2
string_from_object_7 = FromObject(obj=sub_2)
code_block_22 = CodeBlock { ","; }
split_2 = String.Split(str=string_from_object_7, separater0=code_block_22)
firstItem_2 = List.FirstItem(list=split_2@L2)
string_from_array_4 = FromArray(arr=firstItem_2)
code_block_23 = CodeBlock(t7=string_from_array_4) { t6 = String.Replace(t7, ",", " "); t8 = String.Replace(t6, "{", ""); t9 = String.Replace(t8, "}", ""); }
filterByBoolMask_4 = List.FilterByBoolMask(list=getParameterValueByName, mask=isParallel_2)
byKeysValues_2 = Custom[Springs.Dictionary.ByKeysValues](keys=Y, values=filterByBoolMask_4.in, searchKeys=sort_2)
string_from_array_5 = FromArray(arr=byKeysValues_2)
code_block_24 = CodeBlock(t7=string_from_array_5) { t6 = String.Replace(t7, ",", " "); t8 = String.Replace(t6, "{", ""); t9 = String.Replace(t8, "}", ""); }

# group: XML Y-GRID
code_block_25 = CodeBlock { "<Y>"; "</Y>"; "<Y_Lable>"; "</Y_Lable>"; }
concat_8 = String.Concat(string0=code_block_25.out0, string1=code_block_23.t9, string2=code_block_25.out1, string3=code_block_25.out2, string4=code_block_24.t9, string5=code_block_25.out3)

# group: XML Z-GRID
code_block_26 = CodeBlock { "<Z>"; "</Z>"; "<Z_Lable>"; "</Z_Lable>"; "0"; "0+"; }
concat_9 = String.Concat(string0=code_block_26.out0, string1=code_block_26.out4, string2=code_block_26.out1, string3=code_block_26.out2, string4=code_block_26.out5, string5=code_block_26.out3)

# group: XML GRIDS
code_block_27 = CodeBlock { "<Grids>"; "</Grids>"; }
concat_10 = String.Concat(string0=code_block_27.out0, string1=concat_7, string2=concat_8, string3=concat_9, string4=code_block_27.out1)

# group: XML <PROFILES>
code_block_28 = CodeBlock()
# ---------- code_block_28.designscript (7 lines) ----------
"<Profiles>";
"<Number>1</Number>";
"<Profile_name>IPE300</Profile_name>";
"<Material_type>0</Material_type>";
"<Material>S235</Material>";
"<Angle>0</Angle>";
"</Profiles>";
# ----------------------------------------
concat_11 = String.Concat(string0=code_block_28.out0, string1=code_block_28.out1, string2=code_block_28.out2, string3=code_block_28.out3, string4=code_block_28.out4, string5=code_block_28.out5, string6=code_block_28.out6)

Analytical_Beams = Input(Analytical Beams: var[]..[])
curves = Element.Curves(element=Analytical_Beams)
# note: IN [X-FRAME 3D] BEAMS AND COLUMNS ARE BOTH 'BEAMS'
Analytical_Columns = Input(Analytical Columns: var[]..[])
curves_2 = Element.Curves(element=Analytical_Columns)
join = List.Join(list0=curves, list1=curves_2)
code_block_29 = CodeBlock { 1; 2; }
getItemAtIndex = List.GetItemAtIndex(list=join@L2, index=code_block_29.out0)
code_block_30 = CodeBlock { "<Number>"; "</Number>"; }
concat_12 = String.Concat(string0=code_block_30.out0, string2=code_block_30.out1)  # unwired: string1
code_block_31 = CodeBlock { "<From_node_number>"; "</From_node_number>"; }
concat_13 = String.Concat(string0=code_block_31.out0, string2=code_block_31.out1)  # unwired: string1
getItemAtIndex_2 = List.GetItemAtIndex(list=join@L2, index=code_block_29.out1)

# group: STARTPOINT ENDPOINT OF BEAM
endPoint = Curve.EndPoint(curve=getItemAtIndex)
startPoint_3 = Curve.StartPoint(curve=getItemAtIndex_2)

# group: SEARCH THE STARTNODE BELONGING TO THE BEAM
doesIntersect = Geometry.DoesIntersect(geometry=endPoint, other=point, lacing=CrossProduct)
boolean = BoolSelector(true)  # graph input
indexOf = List.IndexOf(list=doesIntersect@L2, element=boolean)
code_block_32 = CodeBlock(x=indexOf) { x+1; }

count_2 = List.Count(list=code_block_32)
code_block_33 = CodeBlock(x=count_2) { 1..x..1; }
string_from_object_8 = FromObject(obj=code_block_33)
code_block_34 = CodeBlock(t3=string_from_object_8) { t2 = String.Split(t3, [","]); t4 = DSCore.List.FirstItem(t2@-2<1>); }
map_5 = List.Map(list=code_block_34.t4, f_x=concat_12)
string_from_object_9 = FromObject(obj=code_block_32)
code_block_35 = CodeBlock(t3=string_from_object_9) { t2 = String.Split(t3, [","]); t4 = DSCore.List.FirstItem(t2@-2<1>); }
map_6 = List.Map(list=code_block_35.t4, f_x=concat_13)

# group: SEARCH THE ENDNODE BELONGING TO THE BEAM
doesIntersect_2 = Geometry.DoesIntersect(geometry=startPoint_3, other=point, lacing=CrossProduct)
boolean_2 = BoolSelector(true)  # graph input
indexOf_2 = List.IndexOf(list=doesIntersect_2@L2, element=boolean_2)
code_block_36 = CodeBlock(x=indexOf_2) { x+1; }

string_from_object_10 = FromObject(obj=code_block_36)
code_block_37 = CodeBlock(t3=string_from_object_10) { t2 = String.Split(t3, [","]); t4 = DSCore.List.FirstItem(t2@-2<1>); }
code_block_38 = CodeBlock { "<To_node_number>"; "</To_node_number>"; }
concat_14 = String.Concat(string0=code_block_38.out0, string2=code_block_38.out1)  # unwired: string1
map_7 = List.Map(list=code_block_37.t4, f_x=concat_14)
join_2 = List.Join(list0=Analytical_Beams, list1=Analytical_Columns)
code_block_39 = CodeBlock { "Cross-Section Rotation"; }
getParameterValueByName_2 = Element.GetParameterValueByName(element=join_2, parameterName=code_block_39)
string_from_object_11 = FromObject(obj=getParameterValueByName_2)
code_block_40 = CodeBlock(t3=string_from_object_11) { t2 = String.Split(t3, [","]); t4 = DSCore.List.FirstItem(t2@-2<1>); }
code_block_41 = CodeBlock { "<Angle>"; "</Angle>"; }
concat_15 = String.Concat(string0=code_block_41.out0, string2=code_block_41.out1)  # unwired: string1
map_8 = List.Map(list=code_block_40.t4, f_x=concat_15)
code_block_42 = CodeBlock()
# ---------- code_block_42.designscript (5 lines) ----------
"<Angle_profile>0</Angle_profile>";
"<Layer>1</Layer>";
"<Profile_number>1</Profile_number>";
"<Z>0</Z>";
"<Top_Center_Bottom>Center</Top_Center_Bottom>";
# ----------------------------------------
concat_16 = String.Concat(string0=code_block_42.out0, string1=code_block_42.out1, string2=code_block_42.out2, string3=code_block_42.out3, string4=code_block_42.out4)
ofRepeatedItem = List.OfRepeatedItem(item=concat_16, amount=count_2)
create_2 = List.Create(item0=map_5, item1=map_6, item2=map_7, item3=map_8, item4=ofRepeatedItem)
transpose_2 = List.Transpose(lists=create_2)
flatten_2 = List.Flatten(list=transpose_2)
string_from_array_6 = FromArray(arr=flatten_2)
code_block_43 = CodeBlock { ","; ""; "{"; "}"; }

# group: XML <BEAMS>
code_block_44 = CodeBlock { "<Beams>"; "</Beams>"; }
replace_4 = String.Replace(str=string_from_array_6, searchFor=code_block_43.out0, replaceWith=code_block_43.out1)
replace_5 = String.Replace(str=replace_4, searchFor=code_block_43.out2, replaceWith=code_block_43.out1)
replace_6 = String.Replace(str=replace_5, searchFor=code_block_43.out3, replaceWith=code_block_43.out1)
concat_17 = String.Concat(string0=code_block_44.out0, string1=replace_6, string2=code_block_44.out1)

# group: XML <LAYERS>
code_block_45 = CodeBlock { "<Layers>"; "<Layer_number>20</Layer_number>"; "<Layer_description>Revit Export</Layer_description>"; "</Layers>"; }
concat_18 = String.Concat(string0=code_block_45.out0, string1=code_block_45.out1, string2=code_block_45.out2, string3=code_block_45.out3)

# group: COMBINE ALL XML-STRINGS
code_block_46 = CodeBlock { "<Nodes/>"; "<Grids/>"; "<Profiles/>"; "<Beams/>"; "<Layers/>"; "</Frame>"; }
code_block_47 = CodeBlock(PROJECTINFORMATION=concat, NODES=concat_6, GRIDS=concat_10, PROFILES=concat_11, BEAMS=concat_17, LAYERS=concat_18, END=code_block_46.out5) { PROJECTINFORMATION; NODES; GRIDS; PROFILES; BEAMS; LAYERS; END; }
concat_19 = String.Concat(string0=code_block_47.PROJECTINFORMATION, string1=code_block_47.NODES, string2=code_block_47.GRIDS, string3=code_block_47.PROFILES, string4=code_block_47.BEAMS, string5=code_block_47.LAYERS, string6=code_block_47.END)

# group: WRITE TO FILE
code_block_48 = CodeBlock { "C:/TEMP/test4.xml"; }
writeText = FileSystem.WriteText(filePath=code_block_48, text=concat_19)
