# Dynamo graph Revit to XFEM4U.dyn (Dynamo 2.12.1.8246)
# packages: Dyn2Calc.Struct4U 0.0.2

code_block = CodeBlock { "C:/TEMP/test134.xml"; }
code_block_2 = CodeBlock { "Grids"; }
byName = Category.ByName(name=code_block_2)
all_elements_of_category = ElementsOfCategory(Category=byName)
select_model_elements = DSModelElementsSelection()  # 55 picked in the model
dyn2Calc_XFEM4U_ExportXML = Custom[Dyn2Calc_XFEM4U_ExportXML](RevitGrids=all_elements_of_category, analyticalElements=select_model_elements)  # package Dyn2Calc.Struct4U; Export XML-file from Revit
writeText = FileSystem.WriteText(filePath=code_block, text=dyn2Calc_XFEM4U_ExportXML)
