# Dynamo graph Xframe3DImportXML.dyf (Dynamo 2.3.0.5885)
# packages: Dyn2Calc.Xframe3D 0.1.2

file_path = Filename("..\..\..\..\Bureaublad\TEMP\1256-5.6 Fundering.xml")  # graph input
xframe3DImportXML = Custom[Xframe3DImportXML](xmlFile=file_path)  # package Dyn2Calc.Xframe3D; Import Xframe3D XML and convert to points, lines and metadata

# group: CREATE BEAMS
family_types = FamilyTypes()  # nothing selected; graph input
byStartPointEndPoint = Line.ByStartPointEndPoint(startPoint=xframe3DImportXML.beamFromNodeNumber, endPoint=xframe3DImportXML.beamToNodeNumber)  # frozen
byTwoPoints = Vector.ByTwoPoints(start=xframe3DImportXML.beamFromNodeNumber, end=xframe3DImportXML.beamToNodeNumber)
ZAxis = Vector.ZAxis()
isParallel = Vector.IsParallel(vector=byTwoPoints, other=ZAxis)
filterByBoolMask = List.FilterByBoolMask(list=xframe3DImportXML.beamProfileName, mask=isParallel)
levels = Levels("00_begane grond")  # graph input
beamByCurve = StructuralFraming.BeamByCurve(curve=filterByBoolMask.out, level=levels)  # unwired: structuralFramingType

beams = Python(IN[0]=filterByBoolMask.out)
# ---------- beams.python (8 lines) ----------
profiles = IN[0]

uniqueprofiles = []
for i in profiles:
    if i not in uniqueprofiles:
        uniqueprofiles.append(i)

OUT = uniqueprofiles
# ----------------------------------------

# group: CREATE GRIDS
byLine = Grid.ByLine(line=xframe3DImportXML.support_nodenumber)
code_block = CodeBlock { "Name"; }
count = List.Count(list=byLine)
code_block_2 = CodeBlock(a=count) { 300..400..a; }
string_from_object = FromObject(obj=code_block_2)
setParameterByName = Element.SetParameterByName(element=byLine, parameterName=code_block, value=string_from_object)
setParameterByName_2 = Element.SetParameterByName(element=setParameterByName, parameterName=code_block, value=xframe3DImportXML.gridYLable)
byLine_2 = Grid.ByLine(line=xframe3DImportXML.support_number)
count_2 = List.Count(list=byLine_2)
code_block_3 = CodeBlock(a=count_2) { 100..200..a; }
string_from_object_2 = FromObject(obj=code_block_3)
setParameterByName_3 = Element.SetParameterByName(element=byLine_2, parameterName=code_block, value=string_from_object_2)
setParameterByName_4 = Element.SetParameterByName(element=setParameterByName_3, parameterName=code_block, value=xframe3DImportXML.gridXLable)

structural_columns = Python(IN[0]=filterByBoolMask.in)  # same code as beams
family_types_2 = FamilyTypes()  # nothing selected; graph input
family_types_3 = FamilyTypes()  # nothing selected; graph input
create = List.Create(item0=family_types_2, item1=family_types_3)
python_script = Python(IN[0]=filterByBoolMask.in, IN[1]=structural_columns, IN[2]=create)
# ---------- python_script.python (24 lines) ----------
import clr
clr.AddReference('ProtoGeometry')
from Autodesk.DesignScript.Geometry import *
#The inputs to this node will be stored as a list in the IN variables.
dataEnteringNode = IN

input = IN[0]
inputChars = IN[1]
inputNumbers = IN[2]

# define Dictionary with the conversion step
myDict = {}

# fill the dictionary
for x in range(0, len(inputChars)):
    myDict[inputChars[x]] = inputNumbers[x]

# convert each item in the list step by step
output = []
for c in input:
    output.append(myDict.get(c))

#Assign your output to the OUT variable.
OUT = output
# ----------------------------------------
points = List.FilterByBoolMask(list=xframe3DImportXML.beamFromNodeNumber, mask=isParallel)
byPoint = FamilyInstance.ByPoint(familyType=python_script, point=points.in)  # frozen
profiles = List.FilterByBoolMask(list=xframe3DImportXML.beamProfileName, mask=isParallel)
flatten = List.Flatten(list=profiles.in)

# group: GRID Y
toNumber = String.ToNumber()  # unwired: str
maximumItem = List.MaximumItem(list=toNumber)
code_block_4 = CodeBlock(xmax=maximumItem) { 0; -3000; xmax+3000; }
toNumber_2 = String.ToNumber()  # unwired: str
byCoordinates = Point.ByCoordinates(x=code_block_4.out1, y=toNumber_2, z=code_block_4.out0)
byCoordinates_2 = Point.ByCoordinates(x=code_block_4.out2, y=toNumber_2, z=code_block_4.out0)
byStartPointEndPoint_2 = Line.ByStartPointEndPoint(startPoint=byCoordinates, endPoint=byCoordinates_2)

# group: GRID X
toNumber_3 = String.ToNumber()  # unwired: str
toNumber_4 = String.ToNumber()  # unwired: str
maximumItem_2 = List.MaximumItem(list=toNumber_4)
code_block_5 = CodeBlock(xmax=maximumItem_2) { 0; -3000; xmax+3000; }
byCoordinates_3 = Point.ByCoordinates(x=toNumber_3, y=code_block_5.out1, z=code_block_5.out0)
byCoordinates_4 = Point.ByCoordinates(x=toNumber_3, y=code_block_5.out2, z=code_block_5.out0)
byStartPointEndPoint_3 = Line.ByStartPointEndPoint(startPoint=byCoordinates_3, endPoint=byCoordinates_4)
