# Dynamo graph Revit to X-frame 3D.dyn (Dynamo 2.3.0.5885)
# packages: Clockwork for Dynamo 2.x 2.1.2, spring nodes 203.1.0

string = StringInput("<?xml version=\"1.0\" encoding=\"utf-8\"?>")  # graph input
code_block = CodeBlock { "Project Information"; }
byName = Category.ByName(name=code_block)
all_elements_of_category = ElementsOfCategory(Category=byName)
code_block_2 = CodeBlock(t1=all_elements_of_category)
# ---------- code_block_2.designscript (11 lines) ----------
ProjectInfo = DSCore.List.FirstItem(t1);
ProjectInfo.GetParameterValueByName("Project Name");
ProjectInfo.GetParameterValueByName("Project Number");
"<Frame>";
"<ProjectName>";
"</ProjectName>";
"<ProjectNumber>";
"</ProjectNumber>";
"<ExportDateTime>";
"</ExportDateTime>";
"<XMLExportVersion> v4.0.30319 </XMLExportVersion>";
# ----------------------------------------
code_block_3 = CodeBlock { t1 = DSCore.DateTime.Now; }
string_from_object = FromObject(obj=code_block_3)
concat = String.Concat(string0=string, string1=code_block_2.out3, string2=code_block_2.out4, string3=code_block_2.out1, string4=code_block_2.out5, string5=code_block_2.out6, string6=code_block_2.out2, string7=code_block_2.out7, string8=code_block_2.out8, string9=string_from_object, string10=code_block_2.out9, string11=code_block_2.out10)
select_model_elements = DSModelElementsSelection()  # 680 picked in the model
category = Custom[Element.Category+](element=select_model_elements)  # package Clockwork for Dynamo 2.x; Returns the category of a given element. Unlike the OOTB node Element.GetCategory, it will work for subcategories, families, family documents, schedules, subcategories and graphics styles as well.
name = Category.Name(category=category)
code_block_4 = CodeBlock { "Analytical Nodes"; }
eq = name == code_block_4
filterByBoolMask = List.FilterByBoolMask(list=select_model_elements, mask=eq)
code_block_5 = CodeBlock(AnalyticalNodes=filterByBoolMask.in) { AnalyticalNodes: var[]..[]; }
count = List.Count(list=code_block_5)

# group: POINT AND NUMBER OF ANALYTICAL NODES
code_block_6 = CodeBlock(x=count) { 1..x..1; }
point = ReferencePoint.Point(referencePoint=code_block_5)

string_from_object_2 = FromObject(obj=code_block_6)
code_block_7 = CodeBlock { "<Number>"; "</Number>"; }
concat_2 = String.Concat(string0=code_block_7.out0, string2=code_block_7.out1)  # unwired: string1
map = List.Map(list=string_from_object_2, f_x=concat_2)
code_block_8 = CodeBlock { dx=152635; dy=-77630; }
code_block_9 = CodeBlock(dx=code_block_8.dx, dy=code_block_8.dy) { -dx; -dy; }
translate = Geometry.Translate(geometry=point, xTranslation=code_block_9.out0, yTranslation=code_block_9.out1)
code_block_10 = CodeBlock(NODES=translate) { t1 = NODES.X; X = Math.Round(t1); Y = Math.Round(NODES.Y); Z = Math.Round(NODES.Z); }
string_from_object_3 = FromObject(obj=code_block_10.X)
code_block_11 = CodeBlock(t3=string_from_object_3) { t2 = String.Split(t3, [","]); t4 = DSCore.List.FirstItem(t2@-2<1>); }
code_block_12 = CodeBlock { "<X>"; "</X>"; }
concat_3 = String.Concat(string0=code_block_12.out0, string2=code_block_12.out1)  # unwired: string1
map_2 = List.Map(list=code_block_11.t4, f_x=concat_3)
string_from_object_4 = FromObject(obj=code_block_10.Y)
code_block_13 = CodeBlock(t3=string_from_object_4) { t2 = String.Split(t3, [","]); t4 = DSCore.List.FirstItem(t2@-2<1>); }
code_block_14 = CodeBlock { "<Y>"; "</Y>"; }
concat_4 = String.Concat(string0=code_block_14.out0, string2=code_block_14.out1)  # unwired: string1
map_3 = List.Map(list=code_block_13.t4, f_x=concat_4)
string_from_object_5 = FromObject(obj=code_block_10.Z)
code_block_15 = CodeBlock(t3=string_from_object_5) { t2 = String.Split(t3, [","]); t4 = DSCore.List.FirstItem(t2@-2<1>); }
code_block_16 = CodeBlock { "<Z>"; "</Z>"; }
concat_5 = String.Concat(string0=code_block_16.out0, string2=code_block_16.out1)  # unwired: string1
map_4 = List.Map(list=code_block_15.t4, f_x=concat_5)
create = List.Create(item0=map, item1=map_2, item2=map_3, item3=map_4)
transpose = List.Transpose(lists=create)
flatten = List.Flatten(list=transpose)
string_from_array = FromArray(arr=flatten)
code_block_17 = CodeBlock { ","; ""; "{"; "}"; "["; }

# group: XML <NODES>
code_block_18 = CodeBlock { "<Nodes>"; "</Nodes>"; }
replace = String.Replace(str=string_from_array, searchFor=code_block_17.out0, replaceWith=code_block_17.out1)
replace_2 = String.Replace(str=replace, searchFor=code_block_17.out2, replaceWith=code_block_17.out1)
replace_3 = String.Replace(str=replace_2, searchFor=code_block_17.out3, replaceWith=code_block_17.out1)
concat_6 = String.Concat(string0=code_block_18.out0, string1=replace_3, string2=code_block_18.out1)

code_block_19 = CodeBlock { "Grids"; }
byName_2 = Category.ByName(name=code_block_19)
all_elements_of_category_2 = ElementsOfCategory(Category=byName_2)
code_block_20 = CodeBlock(Grids=all_elements_of_category_2) { Grids; }
curve = Grid.Curve(grid=code_block_20)
code_block_21 = CodeBlock { "Name"; }
getParameterValueByName = Element.GetParameterValueByName(element=code_block_20, parameterName=code_block_21)

# group: X-GRID ORDER BY COORDINATE CALCULATE DY
direction = Line.Direction(line=curve)
YAxis = Vector.YAxis()
isParallel = Vector.IsParallel(vector=direction, other=YAxis)
filterByBoolMask_2 = List.FilterByBoolMask(list=curve, mask=isParallel)
startPoint = Curve.StartPoint(curve=filterByBoolMask_2.in)
X = Point.X(point=startPoint)
sort = List.Sort(list=X)
code_block_22 = CodeBlock { -1; 0; }
dropItems = List.DropItems(list=sort, amount=code_block_22.out0)
addItemToFront = List.AddItemToFront(item=code_block_22.out1, list=dropItems)
sub = sort - addItemToFront
string_from_object_6 = FromObject(obj=sub)
code_block_23 = CodeBlock { ","; }
split = String.Split(str=string_from_object_6, separator0=code_block_23)
firstItem = List.FirstItem(list=split@L2)
string_from_array_2 = FromArray(arr=firstItem)
code_block_24 = CodeBlock(t7=string_from_array_2) { t6 = String.Replace(t7, ",", " "); t8 = String.Replace(t6, "{", ""); t9 = String.Replace(t8, "}", ""); }
filterByBoolMask_3 = List.FilterByBoolMask(list=getParameterValueByName, mask=isParallel)
byKeysValues = Custom[Springs.Dictionary.ByKeysValues](keys=X, values=filterByBoolMask_3.in, searchKeys=sort)  # package spring nodes; Dictionaries are an incredibly powerful tool for making associative sets between two equal length lists. The first list must be of unique strings (or numbers) and will be the key and the second list will be the matching values (it can be made up of geometry, elements, even other lists) The search keys list will provide the corresponding value to the input key.
string_from_array_3 = FromArray(arr=byKeysValues)
code_block_25 = CodeBlock(t7=string_from_array_3) { t6 = String.Replace(t7, ",", " "); t8 = String.Replace(t6, "{", ""); t9 = String.Replace(t8, "}", ""); }

# group: XML X-GRID
code_block_26 = CodeBlock { "<X>"; "</X>"; "<X_Lable>"; "</X_Lable>"; }
concat_7 = String.Concat(string0=code_block_26.out0, string1=code_block_24.t9, string2=code_block_26.out1, string3=code_block_26.out2, string4=code_block_25.t9, string5=code_block_26.out3)

# group: Y-GRID ORDER BY COORDINATE CALCULATE DX
direction_2 = Line.Direction(line=curve)
XAxis = Vector.XAxis()
isParallel_2 = Vector.IsParallel(vector=direction_2, other=XAxis)
filterByBoolMask_4 = List.FilterByBoolMask(list=curve, mask=isParallel_2)
startPoint_2 = Curve.StartPoint(curve=filterByBoolMask_4.in)
Y = Point.Y(point=startPoint_2)
sort_2 = List.Sort(list=Y)
code_block_27 = CodeBlock { -1; 0; }
dropItems_2 = List.DropItems(list=sort_2, amount=code_block_27.out0)
addItemToFront_2 = List.AddItemToFront(item=code_block_27.out1, list=dropItems_2)
sub_2 = sort_2 - addItemToFront_2
string_from_object_7 = FromObject(obj=sub_2)
code_block_28 = CodeBlock { ","; }
split_2 = String.Split(str=string_from_object_7, separator0=code_block_28)
firstItem_2 = List.FirstItem(list=split_2@L2)
string_from_array_4 = FromArray(arr=firstItem_2)
code_block_29 = CodeBlock(t7=string_from_array_4) { t6 = String.Replace(t7, ",", " "); t8 = String.Replace(t6, "{", ""); t9 = String.Replace(t8, "}", ""); }
filterByBoolMask_5 = List.FilterByBoolMask(list=getParameterValueByName, mask=isParallel_2)
byKeysValues_2 = Custom[Springs.Dictionary.ByKeysValues](keys=Y, values=filterByBoolMask_5.in, searchKeys=sort_2)
string_from_array_5 = FromArray(arr=byKeysValues_2)
code_block_30 = CodeBlock(t7=string_from_array_5) { t6 = String.Replace(t7, ",", " "); t8 = String.Replace(t6, "{", ""); t9 = String.Replace(t8, "}", ""); }

# group: XML Y-GRID
code_block_31 = CodeBlock { "<Y>"; "</Y>"; "<Y_Lable>"; "</Y_Lable>"; }
concat_8 = String.Concat(string0=code_block_31.out0, string1=code_block_29.t9, string2=code_block_31.out1, string3=code_block_31.out2, string4=code_block_30.t9, string5=code_block_31.out3)

# group: XML Z-GRID
code_block_32 = CodeBlock { "<Z>"; "</Z>"; "<Z_Lable>"; "</Z_Lable>"; "0"; "0+"; }
concat_9 = String.Concat(string0=code_block_32.out0, string1=code_block_32.out4, string2=code_block_32.out1, string3=code_block_32.out2, string4=code_block_32.out5, string5=code_block_32.out3)

# group: XML GRIDS
code_block_33 = CodeBlock { "<Grids>"; "</Grids>"; }
concat_10 = String.Concat(string0=code_block_33.out0, string1=concat_7, string2=concat_8, string3=concat_9, string4=code_block_33.out1)

# group: XML <PROFILES>
code_block_34 = CodeBlock()
# ---------- code_block_34.designscript (7 lines) ----------
"<Profiles>";
"<Number>1</Number>";
"<Profile_name>IPE300</Profile_name>";
"<Material_type>0</Material_type>";
"<Material>S235</Material>";
"<Angle>0</Angle>";
"</Profiles>";
# ----------------------------------------
concat_11 = String.Concat(string0=code_block_34.out0, string1=code_block_34.out1, string2=code_block_34.out2, string3=code_block_34.out3, string4=code_block_34.out4, string5=code_block_34.out5, string6=code_block_34.out6)

code_block_35 = CodeBlock { "Analytical Beams"; }
eq_2 = name == code_block_35
filterByBoolMask_6 = List.FilterByBoolMask(list=select_model_elements, mask=eq_2)
code_block_36 = CodeBlock(AnalyticalBeams=filterByBoolMask_6.in) { AnalyticalBeams: var[]..[]; }
curves = Element.Curves(element=code_block_36)
code_block_37 = CodeBlock { "Analytical Columns"; }
eq_3 = name == code_block_37
filterByBoolMask_7 = List.FilterByBoolMask(list=select_model_elements, mask=eq_3)
code_block_38 = CodeBlock(AnalyticalColumns=filterByBoolMask_7.in) { AnalyticalColumns: var[]..[]; }
# note: IN [X-FRAME 3D] BEAMS AND COLUMNS ARE BOTH 'BEAMS'
curves_2 = Element.Curves(element=code_block_38)
join = List.Join(list0=curves, list1=curves_2)
code_block_39 = CodeBlock { 1; 2; }
getItemAtIndex = List.GetItemAtIndex(list=join@L2, index=code_block_39.out0)
code_block_40 = CodeBlock { "<Number>"; "</Number>"; }
concat_12 = String.Concat(string0=code_block_40.out0, string2=code_block_40.out1)  # unwired: string1
code_block_41 = CodeBlock { "<From_node_number>"; "</From_node_number>"; }
concat_13 = String.Concat(string0=code_block_41.out0, string2=code_block_41.out1)  # unwired: string1
getItemAtIndex_2 = List.GetItemAtIndex(list=join@L2, index=code_block_39.out1)

# group: STARTPOINT ENDPOINT OF BEAM
endPoint = Curve.EndPoint(curve=getItemAtIndex)
startPoint_3 = Curve.StartPoint(curve=getItemAtIndex_2)

# group: SEARCH THE STARTNODE BELONGING TO THE BEAM
doesIntersect = Geometry.DoesIntersect(geometry=endPoint, other=point, lacing=CrossProduct)
boolean = BoolSelector(true)  # graph input
indexOf = List.IndexOf(list=doesIntersect@L2, element=boolean)
code_block_42 = CodeBlock(x=indexOf) { x+1; }

count_2 = List.Count(list=code_block_42)
code_block_43 = CodeBlock(x=count_2) { 1..x..1; }
string_from_object_8 = FromObject(obj=code_block_43)
code_block_44 = CodeBlock(t3=string_from_object_8) { t2 = String.Split(t3, [","]); t4 = DSCore.List.FirstItem(t2@-2<1>); }
map_5 = List.Map(list=code_block_44.t4, f_x=concat_12)
string_from_object_9 = FromObject(obj=code_block_42)
code_block_45 = CodeBlock(t3=string_from_object_9) { t2 = String.Split(t3, [","]); t4 = DSCore.List.FirstItem(t2@-2<1>); }
map_6 = List.Map(list=code_block_45.t4, f_x=concat_13)

# group: SEARCH THE ENDNODE BELONGING TO THE BEAM
doesIntersect_2 = Geometry.DoesIntersect(geometry=startPoint_3, other=point, lacing=CrossProduct)
boolean_2 = BoolSelector(true)  # graph input
indexOf_2 = List.IndexOf(list=doesIntersect_2@L2, element=boolean_2)
code_block_46 = CodeBlock(x=indexOf_2) { x+1; }

string_from_object_10 = FromObject(obj=code_block_46)
code_block_47 = CodeBlock(t3=string_from_object_10) { t2 = String.Split(t3, [","]); t4 = DSCore.List.FirstItem(t2@-2<1>); }
code_block_48 = CodeBlock { "<To_node_number>"; "</To_node_number>"; }
concat_14 = String.Concat(string0=code_block_48.out0, string2=code_block_48.out1)  # unwired: string1
map_7 = List.Map(list=code_block_47.t4, f_x=concat_14)
join_2 = List.Join(list0=code_block_36, list1=code_block_38)
code_block_49 = CodeBlock { "Cross-Section Rotation"; }
getParameterValueByName_2 = Element.GetParameterValueByName(element=join_2, parameterName=code_block_49)
string_from_object_11 = FromObject(obj=getParameterValueByName_2)
code_block_50 = CodeBlock(t3=string_from_object_11) { t2 = String.Split(t3, [","]); t4 = DSCore.List.FirstItem(t2@-2<1>); }
code_block_51 = CodeBlock { "<Angle>"; "</Angle>"; }
concat_15 = String.Concat(string0=code_block_51.out0, string2=code_block_51.out1)  # unwired: string1
map_8 = List.Map(list=code_block_50.t4, f_x=concat_15)
code_block_52 = CodeBlock()
# ---------- code_block_52.designscript (5 lines) ----------
"<Angle_profile>0</Angle_profile>";
"<Layer>1</Layer>";
"<Profile_number>1</Profile_number>";
"<Z>0</Z>";
"<Top_Center_Bottom>Center</Top_Center_Bottom>";
# ----------------------------------------
concat_16 = String.Concat(string0=code_block_52.out0, string1=code_block_52.out1, string2=code_block_52.out2, string3=code_block_52.out3, string4=code_block_52.out4)
ofRepeatedItem = List.OfRepeatedItem(item=concat_16, amount=count_2)
create_2 = List.Create(item0=map_5, item1=map_6, item2=map_7, item3=map_8, item4=ofRepeatedItem)
transpose_2 = List.Transpose(lists=create_2)
flatten_2 = List.Flatten(list=transpose_2)
string_from_array_6 = FromArray(arr=flatten_2)
code_block_53 = CodeBlock { ","; ""; "{"; "}"; }

# group: XML <BEAMS>
code_block_54 = CodeBlock { "<Beams>"; "</Beams>"; }
replace_4 = String.Replace(str=string_from_array_6, searchFor=code_block_53.out0, replaceWith=code_block_53.out1)
replace_5 = String.Replace(str=replace_4, searchFor=code_block_53.out2, replaceWith=code_block_53.out1)
replace_6 = String.Replace(str=replace_5, searchFor=code_block_53.out3, replaceWith=code_block_53.out1)
concat_17 = String.Concat(string0=code_block_54.out0, string1=replace_6, string2=code_block_54.out1)

# group: XML <LAYERS>
code_block_55 = CodeBlock { "<Layers>"; "<Layer_number>20</Layer_number>"; "<Layer_description>Revit Export</Layer_description>"; "</Layers>"; }
concat_18 = String.Concat(string0=code_block_55.out0, string1=code_block_55.out1, string2=code_block_55.out2, string3=code_block_55.out3)

# group: COMBINE ALL XML-STRINGS
code_block_56 = CodeBlock { "<Nodes/>"; "<Grids/>"; "<Profiles/>"; "<Beams/>"; "<Layers/>"; "</Frame>"; }
code_block_57 = CodeBlock(PROJECTINFORMATION=concat, NODES=concat_6, GRIDS=concat_10, PROFILES=concat_11, BEAMS=concat_17, LAYERS=concat_18, END=code_block_56.out5) { PROJECTINFORMATION; NODES; GRIDS; PROFILES; BEAMS; LAYERS; END; }
concat_19 = String.Concat(string0=code_block_57.PROJECTINFORMATION, string1=code_block_57.NODES, string2=code_block_57.GRIDS, string3=code_block_57.PROFILES, string4=code_block_57.BEAMS, string5=code_block_57.LAYERS, string6=code_block_57.END)

code_block_58 = CodeBlock { "["; "]"; ""; }
replace_7 = String.Replace(str=concat_19, searchFor=code_block_58.out0, replaceWith=code_block_58.out2)
replace_8 = String.Replace(str=replace_7, searchFor=code_block_58.out1, replaceWith=code_block_58.out2)
code_block_59 = CodeBlock(xmlstring=replace_8) { xmlstring; }

# group: WRITE TO FILE
code_block_60 = CodeBlock { "C:/TEMP/test100.xml"; }
writeText = FileSystem.WriteText(filePath=code_block_60, text=code_block_59)

byName_3 = Category.ByName(name=code_block_37)
all_elements_of_category_3 = ElementsOfCategory(Category=byName_3)
byName_4 = Category.ByName(name=code_block_35)
all_elements_of_category_4 = ElementsOfCategory(Category=byName_4)
byName_5 = Category.ByName(name=code_block_4)
all_elements_of_category_5 = ElementsOfCategory(Category=byName_5)
code_block_61 = CodeBlock { 2; 0; }
takeEveryNthItem = List.TakeEveryNthItem(list=code_block_5, n=code_block_61.out0, offset=code_block_61.out1)
