# Dynamo graph Xframe3D Supports to Revit.dyn (Dynamo 2.3.0.5885)
# packages: Dyn2Calc.Xframe3D 0.1.2

file_path = Filename("..\..\..\..\..\..\..\3BM\50_projecten\3_3BM_bouwtechniek\1256_Berekening_woning_Oudekerk_aan_de_Ijssel\1256_71_constructie_advies\1256-5.6 Fundering.xml")  # graph input
dyn2Calc_Xframe3D_ImportXML = Custom[Dyn2Calc_Xframe3D_ImportXML](xmlFile=file_path)  # package Dyn2Calc.Xframe3D; Import Xframe3D XML and convert to points, lines and metadata
watch = Watch(dyn2Calc_Xframe3D_ImportXML.Xframe3DXMLData_Nodes)
code_block = CodeBlock(a=watch) { a[5]; a[1]; }
watch_2 = Watch(dyn2Calc_Xframe3D_ImportXML.Xframe3DXMLData_Supports)
code_block_2 = CodeBlock(a=watch_2) { a[2]; }
watch_3 = Watch(code_block_2)
toNumber = String.ToNumber(str=watch_3)
python_script = Python(IN[0]=code_block.out1, IN[1]=toNumber)
# ---------- python_script.python (15 lines) ----------
import clr
clr.AddReference('ProtoGeometry')
from Autodesk.DesignScript.Geometry import *
#The inputs to this node will be stored as a list in the IN variables.
dataEnteringNode = IN

lst = IN[0]
value = IN[1]

indices = []
for i in value:
	indices.append(lst.index(i))

#Assign your output to the OUT variable.
OUT = indices
# ----------------------------------------
getItemAtIndex = List.GetItemAtIndex(list=code_block.out0, index=python_script)
code_block_3 = CodeBlock { 200; }
byCenterPointRadius = Circle.ByCenterPointRadius(centerPoint=getItemAtIndex, radius=code_block_3)

# group: PLACE PILES
family_types = FamilyTypes("NLRS_17_SF_funderingspaal:Type 1")
byPoint = FamilyInstance.ByPoint(familyType=family_types, point=getItemAtIndex)
