# Dynamo graph Xframe3DToRevit.dyn (Dynamo 2.0.2.6826)

file_path = Filename("Examples\staal_edit.xml")  # graph input
xframe3DImportXML = Custom[Xframe3DImportXML](xmlFile=file_path)  # Import Xframe3D XML and convert to points, lines and metadata

# group: PROJECTINFORMATION
watch = Watch(xframe3DImportXML.projectInformation)

# group: CREATE BEAMS
family_types = FamilyTypes()  # nothing selected; graph input
byStartPointEndPoint = Line.ByStartPointEndPoint(startPoint=xframe3DImportXML.beamFromNodeNumber, endPoint=xframe3DImportXML.beamToNodeNumber)
byTwoPoints = Vector.ByTwoPoints(start=xframe3DImportXML.beamFromNodeNumber, end=xframe3DImportXML.beamToNodeNumber)
ZAxis = Vector.ZAxis()
isParallel = Vector.IsParallel(vector=byTwoPoints, other=ZAxis)
filterByBoolMask = List.FilterByBoolMask(list=xframe3DImportXML.beamProfileName, mask=isParallel)
levels = Levels(index=0)  # graph input
beamByCurve = StructuralFraming.BeamByCurve(curve=filterByBoolMask.out, level=levels)  # unwired: structuralFramingType

beams = Python(IN[0]=filterByBoolMask.out)
# ---------- beams.python (8 lines) ----------
profiles = IN[0]

uniqueprofiles = []
for i in profiles:
    if i not in uniqueprofiles:
        uniqueprofiles.append(i)

OUT = uniqueprofiles
# ----------------------------------------

# group: CREATE GRIDS
byLine = Grid.ByLine(line=xframe3DImportXML.gridYline)
code_block = CodeBlock { "Name"; }
count = List.Count(list=byLine)
code_block_2 = CodeBlock(a=count) { 300..400..a; }
string_from_object = FromObject(obj=code_block_2)
setParameterByName = Element.SetParameterByName(element=byLine, parameterName=code_block, value=string_from_object)
setParameterByName_2 = Element.SetParameterByName(element=setParameterByName, parameterName=code_block, value=xframe3DImportXML.gridYLable)
byLine_2 = Grid.ByLine(line=xframe3DImportXML.gridXline)
count_2 = List.Count(list=byLine_2)
code_block_3 = CodeBlock(a=count_2) { 100..200..a; }
string_from_object_2 = FromObject(obj=code_block_3)
setParameterByName_3 = Element.SetParameterByName(element=byLine_2, parameterName=code_block, value=string_from_object_2)
setParameterByName_4 = Element.SetParameterByName(element=setParameterByName_3, parameterName=code_block, value=xframe3DImportXML.gridXLable)

structural_columns = Python(IN[0]=filterByBoolMask.in)  # same code as beams
family_types_2 = FamilyTypes()  # nothing selected; graph input
family_types_3 = FamilyTypes()  # nothing selected; graph input
create = List.Create(item0=family_types_2, item1=family_types_3)
python_script = Python(IN[0]=filterByBoolMask.in, IN[1]=structural_columns, IN[2]=create)
# ---------- python_script.python (24 lines) ----------
import clr
clr.AddReference('ProtoGeometry')
from Autodesk.DesignScript.Geometry import *
#The inputs to this node will be stored as a list in the IN variables.
dataEnteringNode = IN

input = IN[0]
inputChars = IN[1]
inputNumbers = IN[2]

# define Dictionary with the conversion step
myDict = {}

# fill the dictionary
for x in range(0, len(inputChars)):
    myDict[inputChars[x]] = inputNumbers[x]

# convert each item in the list step by step
output = []
for c in input:
    output.append(myDict.get(c))

#Assign your output to the OUT variable.
OUT = output
# ----------------------------------------
points = List.FilterByBoolMask(list=xframe3DImportXML.beamFromNodeNumber, mask=isParallel)
byPoint = FamilyInstance.ByPoint(familyType=python_script, point=points.in)
profiles = List.FilterByBoolMask(list=xframe3DImportXML.beamProfileName, mask=isParallel)
flatten = List.Flatten(list=profiles.in)
